% Simulink data dictionary TV_FLC_V3_Codegen_BusDefs.sldd

Fuzzy_Bus = Simulink.Bus()
  Mz_yaw: single
  Mz_Beta: single
  FIS_In: single[1 4]

TV_Bus = Simulink.Bus()
  State: single
  Controller: Bus: Fuzzy_Bus

kappa_rl_ref_Bus = Simulink.Bus()
  kappa_rl_ref: single

kappa_rr_ref_Bus = Simulink.Bus()
  kappa_rr_ref: single

PID_ref_Bus = Simulink.Bus()
  PID_rl: Bus: kappa_rl_ref_Bus
  PID_rr: Bus: kappa_rr_ref_Bus

Tmax_Bus = Simulink.Bus()
  Tmax_rl_Nm: single
  Tmax_rr_Nm: single

Slip_Bus = Simulink.Bus()
  State: single
  Controller: Bus: PID_ref_Bus
  TmaxOut: Bus: Tmax_Bus

Debug = Simulink.Bus()
  TV: Bus: TV_Bus
  Slip: Bus: Slip_Bus